# Grasshopper definition main.gh (Grasshopper 1.0.7)
# Copyright: Job de Vogel

curve_center_grid = Slider(0.586, range=0..1)
water_offset = Slider(107, range=0..150)
north_border = Slider(0.888, range=0..1)
south_border = Slider(0.034, range=0..1)
dike_cut_size = Slider(50, range=-50..75)
dike_offset = Slider(50, range=0..100)
z_grid_size = Slider(6, range=0..10)
grid_size_x = Slider(12, range=0..12)
grid_size_y = Slider(24, range=0..24)
x_size_grid = Slider(175, range=0..175)
y_size_grid = Slider(300, range=0..300)
distribution_height = Slider(12, range=0..100)

column_radius = Slider(0.4, range=0..1)
# main_base.gh
# Add hops component with main_base script
curve = Curve(<curve referenced from the Rhino model>)

balcony_type = BooleanToggle(False)
grid_size = Slider(7.2, range=0..10)
core_x_size = Slider(15, range=0..100)
shell_offset = Slider(1.8, range=0..10)
balcony_depth = Slider(0.6, range=0..10)
levels = Slider(37, range=0..40)
levels_per_level = Slider(1, range=0..10)
level_height = Slider(3.8, range=0..10)
core_x_distance = Slider(10, range=0..100)
core_y_distance = Slider(10, range=0..100)
core_y_size = Slider(15, range=0..100)

curve_2 = Curve(<curve referenced from the Rhino model>)
core_corner = Slider(0, range=0..3)
x_size_small_core = Slider(9, range=0..15)
y_size_small_core = Slider(10, range=0..15)
core_split_level = Slider(20, range=0..30)

truss_x_grid_distance = Slider(7.2, range=0..10)
truss_1_height = Slider(30, range=0..30)
facade_truss_x_width = Slider(6.9, range=0..10)
facade_truss_y_width = Slider(8.1, range=0..10)
truss_2_height = Slider(16, range=0..30)
truss_height = Slider(4.2, range=0..8.4)
truss_count_center = Slider(3, range=0..10)
truss_count_endings = Slider(2, range=0..10)

boolean_toggle = BooleanToggle(True)

balcony_type_2 = BooleanToggle(False)
grid_size_2 = Slider(7.2, range=0..10)
shell_offset_2 = Slider(1.8, range=0..10)
# COPY TOP SCRIPT TOWER TO BOTTOM
balcony_depth_2 = Slider(0.6, range=0..10)
levels_2 = Slider(37, range=0..40)
levels_per_level_2 = Slider(1, range=0..10)
level_height_2 = Slider(3.8, range=0..10)
core_x_distance_2 = Slider(10, range=0..100)
core_y_distance_2 = Slider(10, range=0..100)
core_x_size_2 = Slider(15, range=0..100)
core_y_size_2 = Slider(15, range=0..100)

# ----
# main_towers.gh
curve_3 = Curve(<curve referenced from the Rhino model>)
# main_towers.gh
# Add hops component with towers script
number_slider = Slider(1, range=0..1)
core_corner_2 = Slider(0, range=0..3)
x_size_small_core_2 = Slider(9, range=0..15)
y_size_small_core_2 = Slider(10, range=0..15)
core_split_level_2 = Slider(20, range=0..30)

truss_1_height_2 = Slider(22, range=0..30)
facade_truss_x_width_2 = Slider(6.9, range=0..10)
facade_truss_y_width_2 = Slider(8.1, range=0..10)
truss_x_grid_distance_2 = Slider(7.2, range=0..10)
truss_2_height_2 = Slider(16, range=0..30)
truss_height_2 = Slider(4.2, range=0..8.4)
truss_count_center_2 = Slider(3, range=0..10)
truss_count_endings_2 = Slider(2, range=0..10)

boolean_toggle_2 = BooleanToggle(True)
# main_structure.gh
data_dam = DataDam(BufferDelay=10000000, BufferMode=0)
data_dam_2 = DataDam(BufferDelay=10000000, BufferMode=0)
merge = Merge()
merge_2 = Merge()

v_panel_height = Slider(3.8, range=0..10)
u_panel_width = Slider(1.8, range=0..10)
angle = Slider(10, range=0..100)
straight_offset = Slider(0, range=0..1)
angled_offset = Slider(0.1, range=0..1)
frame_width_inner = Slider(0.1, range=0..1)
frame_width_outer = Slider(0.1, range=0..1)
# Add hops component with structure script
tolerance_2 = Slider(0.001, range=0..0.001)

# ---- group: Generate Facade
data_dam_3 = DataDam(BufferDelay=10000000, BufferMode=0)

# ----
construct_matrix = ConstructMatrix(Rows="4", Columns="4")

# ----
# main_structure.gh
tolerance = Slider(0.001, range=0..0.001)
v_panel_height_2 = Slider(3.8, range=0..10)
angle_2 = Slider(10, range=0..100)
straight_offset_2 = Slider(0, range=0..1)
angled_offset_2 = Slider(0.1, range=0..1)
frame_width_inner_2 = Slider(0.1, range=0..1)
frame_width_outer_2 = Slider(0.1, range=0..1)
u_panel_width_2 = Slider(1.2, range=0..10)

# ---- group: Generate Facade
data_dam_4 = DataDam(BufferDelay=10000000, BufferMode=0)

# ----
construct_matrix_2 = ConstructMatrix(Rows="4", Columns="4")
# main_facade.gh
negative = Negative(Value=angle)
negative_2 = Negative(Value=straight_offset)
negative_3 = Negative(Value=angled_offset)
merge_3 = Merge()
# main_facade.gh
negative_4 = Negative(Value=angle_2)
negative_5 = Negative(Value=straight_offset_2)
negative_6 = Negative(Value=angled_offset_2)
merge_4 = Merge()
# Add hops component with facade script
merge_5 = Merge()
merge_6 = Merge()
transform = Transform(Geometry=merge, Transform=construct_matrix)
transform_2 = Transform(Geometry=merge_5, Transform=construct_matrix)
transform_3 = Transform(Geometry=merge_3, Transform=construct_matrix)
transform_4 = Transform(Geometry=merge_2, Transform=construct_matrix_2)
transform_5 = Transform(Geometry=merge_6, Transform=construct_matrix_2)
transform_6 = Transform(Geometry=merge_4, Transform=construct_matrix_2)
geometry = Geometry(transform_3)
geometry_2 = Geometry(transform_2)
geometry_3 = Geometry(transform)
geometry_4 = Geometry(transform_6)
geometry_5 = Geometry(transform_4)
geometry_6 = Geometry(transform_5)
